# Grasshopper definition TextureSlicer_UI.gh (Grasshopper 1.0.7)
# plug-ins: Droid, Human UI

# ----
# Input variables
vertical_spacing = Slider(1, range=0..5)
amplitude = Slider(3, range=0..5)
# Slicer parameters
interval = Slider(3, range=0..5)

slider = CreateSlider(Slider=interval, ShowBounds=False, ShowTicks=False, ShowTooltip=False, ShowValLabel=True, showLabel=True)
slider_2 = CreateSlider(Slider=vertical_spacing, ShowBounds=False, ShowTicks=False, ShowTooltip=False, ShowValLabel=True, showLabel=True)
slider_3 = CreateSlider(Slider=amplitude, ShowBounds=False, ShowTicks=False, ShowTooltip=False, ShowValLabel=True, showLabel=True)
values = ValueListener(Elements=slider, SomeProperty=True)  # -> Values, Indices
values_2 = ValueListener(Elements=slider_3, SomeProperty=True)  # -> Values, Indices
values_3 = ValueListener(Elements=slider_2, SomeProperty=True)  # -> Values, Indices

bed_temperature = Slider(50, range=0..100)
tool_temperature = Slider(200, range=0..270)
wall_count = Slider(3, range=0..10)
nozzle_size = Slider(0.4, range=0.2..0.6)
base_layers = Slider(3, range=0..10)
layer_height = Slider(0.2, range=0.1..0.5)
slider_4 = CreateSlider(Slider=layer_height, ShowBounds=False, ShowTicks=False, ShowTooltip=False, ShowValLabel=True, showLabel=True)
slider_5 = CreateSlider(Slider=nozzle_size, ShowBounds=False, ShowTicks=False, ShowTooltip=False, ShowValLabel=True, showLabel=True)
slider_6 = CreateSlider(Slider=tool_temperature, ShowBounds=False, ShowTicks=False, ShowTooltip=False, ShowValLabel=True, showLabel=True)
slider_7 = CreateSlider(Slider=wall_count, ShowBounds=False, ShowTicks=False, ShowTooltip=False, ShowValLabel=True, showLabel=True)
slider_8 = CreateSlider(Slider=bed_temperature, ShowBounds=False, ShowTicks=False, ShowTooltip=False, ShowValLabel=True, showLabel=True)
slider_9 = CreateSlider(Slider=base_layers, ShowBounds=False, ShowTicks=False, ShowTooltip=False, ShowValLabel=True, showLabel=True)
button = CreateButton(ButtonName="update", ButtonStyle=0)
values_4 = ValueListener(Elements=button, SomeProperty=True)  # -> Values, Indices
values_5 = ValueListener(Elements=slider_7, Trigger=values_4.Values, SomeProperty=False)  # -> Values, Indices
values_6 = ValueListener(Elements=slider_4, Trigger=values_4.Values, SomeProperty=False)  # -> Values, Indices
values_7 = ValueListener(Elements=slider_6, Trigger=values_4.Values, SomeProperty=False)  # -> Values, Indices
values_8 = ValueListener(Elements=slider_8, Trigger=values_4.Values, SomeProperty=False)  # -> Values, Indices
values_9 = ValueListener(Elements=slider_5, Trigger=values_4.Values, SomeProperty=False)  # -> Values, Indices
values_10 = ValueListener(Elements=slider_9, Trigger=values_4.Values, SomeProperty=False)  # -> Values, Indices

# ----
# Settings
layer_height_2 = Panel(values_6.Values)
nozzle_size_2 = Panel(values_9.Values)
wall_count_2 = Panel(values_5.Values)
top_layer_count = Panel(values_10.Values)
first_layer_height = Panel("0.1")
flow_rate = Panel("85")
infill = Panel("0.4")
retraction = BooleanToggle(True)
print_speed_mm_s = Panel("15")
travel_speed = Panel("40")
retraction_speed = Panel("40")
retraction_dist = Panel("1")
x_build_plate = Panel("300")
y_build_plate = Panel("200")
z_build_plate = Panel("300")
bottom_layer_count = Panel("3")
dvolc = DroidVolumeCartesian(Width=x_build_plate, Depth=y_build_plate, Height=z_build_plate)  # -> DroidVolume, Preview
dpmters = DroidParameters(
    LayerHeight=layer_height_2,
    FirstLayerHeight=first_layer_height,
    Precision=128,
    Nozzle=nozzle_size_2,
    Infill=infill,
    ShellNumber=wall_count_2,
    BrimSkirt=False,
    BrimSkirtDistance=0,
    Top=top_layer_count,
    Bottom=bottom_layer_count,
    PrintSpeed=print_speed_mm_s,
    TravelSpeed=travel_speed,
    Retraction=retraction,
    RectractionDistance=retraction_dist,
    RetractionSpeed=retraction_speed,
    FilamentDiameter=1.75,
    FlowRate=flow_rate)

heated_bead = BooleanToggle(True)
t1_temp = Panel("0")
t3_temp = Panel("0")
t2_temp = Panel("0")
t0_temp = Panel(values_7.Values)
bed_temp = Panel(values_8.Values)
merge = Merge(Data1=t0_temp, Data2=t1_temp, Data3=t2_temp, Data4=t3_temp)
c_script = CSharpScript(bool_heated_bed=heated_bead, bed_temp=bed_temp, tool_temp=merge)  # -> out, flatten(header_gcode); inputs bool_heated_bed: Boolean, tool_temp: list of Int32
# ---------- c_script: C# ----------
    string header = "; Gcode produced with DROID and Justin for Grasshopper Rhino\n";
    header += "G90\nM82\nM107 ;  fan turn off\n";

    for(int i = 0; i < tool_temp.Count;i++)
    {
      if(tool_temp[i] != 0)header += String.Format("G10 P{0} S{1} R{2}\n", i, tool_temp[i], tool_temp[i] - 20);
    }
    if(bool_heated_bed) header += String.Format("M190 S{0}\n", bed_temp);
    header += "T0\n";
    //header += "G28 ; homing all axis \nG29 ;  Mesh Bed Leveling\nG91 Z25\n";
    string[] arr = header.Split('\n');
    List<string> outp = new List<string>();
    foreach (string ele in arr)
    {
      if (ele.Length > 0)
      {
        outp.Add(ele);
      }
    }
    header_gcode = outp;
# ---------- end c_script ----------
end_code = Panel("""T-1 ; dock the active tool
G1 X5 Y5 F20000 ; parking toolchanger
G10 P0 S0 R0 ; set active and standby temperature
G10 P1 S0 R0 ; set active and standby temperature
G10 P2 S0 R0 ; set active and standby temperature
G10 P3 S0 R0 ; set active and standby temperature
M0 ; turn off all heater
M84 ; disable motors
G1 Z25""")
start_code = Panel(c_script.header_gcode)

# ----
# Path preview placeholder
number_slider = Slider(30, range=0..100)
rectangle = Rectangle(Plane=PlaneXY(0, 0, 0), XSize=number_slider, YSize=number_slider, Radius=0)  # -> Rectangle, Length
area = Area(Geometry=rectangle.Rectangle)  # -> Area, Centroid
circle = CircleCNR(Center=area.Centroid, Normal=Vector(0, 0, 1), Radius=expr("x/2", number_slider))

# ----
# Path preview generation
number_slider_2 = Slider(3, range=0..10)
crv = Curve(circle)

# ----
# "Texture" tab
colour = ColourPicker(PickedColour=RGB(31, 48, 128))
pickbtn = CreateRhinoPickButton(ButtonName="geometry", Prompt="Please select geometry...", AllowMultiple=False, AllowNone=True, Type=1, ButtonStyle=0)
values_11 = ValueListener(Elements=pickbtn, SomeProperty=True)  # -> Values, Indices
tb = CreateTextBlock(Text="Select the geometry to apply texture", TextSize=Slider(18, range=0..100), Justification=1)
tb_2 = CreateTextBlock(Text="Adjust texture parameters", TextSize=Slider(18, range=0..100), Justification=1)
tb_3 = CreateTextBlock(Text="Pattern diagram(top view)", TextSize=Slider(18, range=0..100), Justification=1)

# ----
# Texture-Slicer
brep = Brep(values_11.Values)

# ----
# Preprocessing
number_slider_3 = Slider(0.2, range=0..1)
contour = Contour(Shape=brep, Point=Point(0, 0, 0), Direction=Vector(0, 0, 1), Distance=number_slider_3)  # -> flatten(Contours)
xy = XYPlane(Origin=Point(0, 0, 0))
toggle = BooleanToggle(False)
cull_i = CullIndex(List=contour, Indices="0", Wrap=True)
c_script_2 = CSharpScript(
    crv=cull_i,
    Xnoise=values_2.Values,
    Ynoise=values.Values,
    plane=xy,
    onedir=toggle,
    spacing=values_3.Values,
    layerHeight=layer_height_2)  # -> out, flatten(A); inputs crv: list of Curve, Xnoise: Double, Ynoise: Double, plane: Plane, onedir: Boolean, spacing: Int32, layerHeight: Double
# ---------- c_script_2: C# ----------
    List<Curve> offset = new List<Curve>();
    List<Curve> inf = new List<Curve>();
    List<Curve> baseInf = new List<Curve>();
    List<Curve> otherInf = new List<Curve>();
    int len = (crv.Count - 2);
    int crvct = 0;
    // calculate how many layers we skip for vertical spacing 
    int layers = Convert.ToInt32((1 / layerHeight) * spacing);
    
    // if noise is 0, then there is no texture to apply
    if (Xnoise != 0 && Ynoise != 0)
    {
      List<Curve> offset_noise = new List<Curve>();
      for (int i = 0; i < crv.Count; i++)
      {
        Curve curr = crv[i];
        Curve prev = curr;
        Curve[] next = curr.Offset(plane, Xnoise, 0.01, CurveOffsetCornerStyle.Sharp);
        List<Point3d> currpt = new List<Point3d>();
        Point3d[] currA, prevA, nextA;
        /* 
            divide the shape into segments
            original shape by wave interval distance 
            offset, copy of original in two times more segments
            connect every 2nd point on these shapes
        */
        curr.DivideByLength(Ynoise, true, out currA);
        int seg = 0;
        if (currA != null)
          seg = currA.Length;
        prev.DivideByCount(2 * seg, true, out prevA);
        next[0].DivideByCount(2 * seg, true, out nextA);
        if (spacing == 0 || i < layers || (i - layers) % layers != 0)
        {
          offset_noise.Add(curr);
        }
        else
        {
          // shift the direction every textured layer to apply symmetry
          int shift = crvct % 2;
          if (shift != 0)
            currpt.Add(nextA[0]);
          for (int j = 0; j <= seg; j++)
          {
            if (2 * j + shift < 2 * seg)
              currpt.Add(prevA[2 * j + shift]);
            if (2 * j + shift + 1 < 2 * seg)
              currpt.Add(nextA[2 * j + shift + 1]);
          }
          if (shift == 0)
            currpt.Add(prevA[0]);
          else
            currpt.Add(nextA[0]);
          PolylineCurve curr_res = new PolylineCurve(currpt);
          offset_noise.Add(curr_res);
          crvct++;
        }
      }
      offset = offset_noise;

    }
    else
    {
      offset = crv;
    }
    A = offset;
# ---------- end c_script_2 ----------

c_script_3 = CSharpScript(
    crv=graft(crv),
    Xnoise=number_slider_2,
    Ynoise=number_slider_2,
    plane=xy,
    onedir=toggle,
    spacing=number_slider_2,
    layerHeight=layer_height_2)  # -> out, flatten(A); inputs crv: list of Curve, Xnoise: Double, Ynoise: Double, plane: Plane, onedir: Boolean, spacing: Int32, layerHeight: Double
# ---------- c_script_3: C# ----------
    List<Curve> offset = new List<Curve>();
    List<Curve> inf = new List<Curve>();
    List<Curve> baseInf = new List<Curve>();
    List<Curve> otherInf = new List<Curve>();
    int len = (crv.Count - 2);
    int crvct = 0;
    // calculate how many layers we skip for vertical spacing
    int layers = Convert.ToInt32((1 / layerHeight) * spacing);

    // if noise is 0, then there is no texture to apply
    if (Xnoise != 0 && Ynoise != 0)
    {
      List<Curve> offset_noise = new List<Curve>();
      for (int i = 0; i < crv.Count; i++)
      {
        Curve curr = crv[i];
        Curve prev = curr;
        Curve[] next = curr.Offset(plane, Xnoise, 0.01, CurveOffsetCornerStyle.Sharp);
        List<Point3d> currpt = new List<Point3d>();
        Point3d[] currA, prevA, nextA;
        /*
            divide the shape into segments
            original shape by wave interval distance
            offset, copy of original in two times more segments
            connect every 2nd point on these shapes
        */
        curr.DivideByLength(Ynoise, true, out currA);
        int seg = 0;
        if (currA != null)
          seg = currA.Length;
        prev.DivideByCount(2 * seg, true, out prevA);
        next[0].DivideByCount(2 * seg, true, out nextA);
        if (1<0)
        {
          offset_noise.Add(curr);
        }
        else
        {
          // shift the direction every textured layer to apply symmetry
          int shift = crvct % 2;
          if (shift != 0)
            currpt.Add(nextA[0]);
          for (int j = 0; j <= seg; j++)
          {
            if (2 * j + shift < 2 * seg)
              currpt.Add(prevA[2 * j + shift]);
            if (2 * j + shift + 1 < 2 * seg)
              currpt.Add(nextA[2 * j + shift + 1]);
          }
          if (shift == 0)
            currpt.Add(prevA[0]);
          else
            currpt.Add(nextA[0]);
          PolylineCurve curr_res = new PolylineCurve(currpt);
          offset_noise.Add(curr_res);
          crvct++;
        }
      }
      offset = offset_noise;

    }
    else
    {
      offset = crv;
    }
    A = offset;
# ---------- end c_script_3 ----------
bbox = BoundingBox(Content=c_script_3.A, Plane=PlaneXY(0, 0, 0))  # -> Box, Box_2
box_corners = BoxCorners(Box=bbox.Box)  # -> CornerA, CornerB, CornerC, CornerD, CornerE, CornerF, CornerG, CornerH
move = Move(Geometry=c_script_3.A, Motion=expr("-x", box_corners.CornerD))  # -> Geometry, Transform

lng = ListLength(List=contour)
item = ListItem(List=contour, Index=expr("x/2", lng), Wrap=True)
c_script_4 = CSharpScript(
    crv=flatten(item),
    Xnoise=values_2.Values,
    Ynoise=values.Values,
    plane=xy,
    onedir=toggle,
    spacing=values_3.Values,
    layerHeight=layer_height_2)  # -> out, flatten(A); inputs crv: list of Curve, Xnoise: Double, Ynoise: Double, plane: Plane, onedir: Boolean, spacing: Int32, layerHeight: Double; same code as c_script_3
bbox_2 = BoundingBox(Content=c_script_4.A, Plane=PlaneXY(0, 0, 0))  # -> Box, Box_2
box_corners_2 = BoxCorners(Box=bbox_2.Box)  # -> CornerA, CornerB, CornerC, CornerD, CornerE, CornerF, CornerG, CornerH
move_2 = Move(Geometry=c_script_4.A, Motion=expr("-x", box_corners_2.CornerD))  # -> Geometry, Transform

# ----
# Display path
number_slider_4 = Slider(5, range=0..100)
colour_2 = ColourPicker(PickedColour=RGB(30, 54, 217))
swatch = Blue(SwatchColor=RGB(0, 128, 255))
shape = CreateShape(Shape=move.Geometry, StrokeColor=swatch, Scale=1)
horizontal_alignment = ValueList({"Left": 0, "Center": 1, "Right": 2}, selected="Center")
setshape = SetShape(ShapeToModify=shape, ShapeCurve=move_2.Geometry, StrokeColor=colour_2, Scale=number_slider_4)
adjustpos = AdjustElementPositioning(ElementsToAdjust=shape, AbsolutePositioning=False, HorizontalAlignment=horizontal_alignment)

# ----
# Generation
number_slider_5 = Slider(2, range=0..10)
number_slider_6 = Slider(0.5, range=0..1)
xy_2 = XYPlane(Origin=Point(0, 0, 0))
c_script_5 = CSharpScript(crv=contour, wallCount=wall_count_2, plane=xy_2, distance=number_slider_6, layers=top_layer_count)  # -> out, walls, infWall, baseWall, A; inputs crv: list of Curve, wallCount: Int32, plane: Plane, distance: Double, layers: Int32
# ---------- c_script_5: C# ----------
    List<Curve> offset = new List<Curve>();
    List<Curve> inf = new List<Curve>();
    List<Curve> baseInf = new List<Curve>();
    List<Curve> otherInf = new List<Curve>();
    int len = (crv.Count - 2);
    /*
       separate outer wall for infill layers (infWall) and base layers (baseInf)
       walls are computed as extra outer walls - adjustable value
    */
    for (int i = 0; i < wallCount + 1; i++)
    {
      for (int j = 0; j <= len; j++)
      {
        Curve tmp_offset = crv[j];
        List<Curve[]> offset_list = new List<Curve[]>();
        Curve[] offset_crv = tmp_offset.Offset(plane, -distance * (i + 1), 0.01, CurveOffsetCornerStyle.Sharp);
        double curr_area = -1, prev_area = -2;
        if (offset_crv != null)
        {
          curr_area = Rhino.Geometry.AreaMassProperties.Compute(offset_crv[0]).Area;
          prev_area = Rhino.Geometry.AreaMassProperties.Compute(tmp_offset).Area;
          }
        if (curr_area < prev_area)
        {
          if (i == wallCount)
          {

            inf.Add(offset_crv[0]);
          }
          else
          {
            offset.Add(offset_crv[0]);
          }
        }
      }
    }

    /*
       split between infill and base - based on slicer settings
    */
    for (int i = 0; i < inf.Count; i++)
    {
      if (i < layers || i > inf.Count - 1 - layers)
      {
        baseInf.Add(inf[i]);
      }
      else
      {
        otherInf.Add(inf[i]);
      }
    }
    walls = offset;
    infWall = otherInf;
    baseWall = baseInf;
    A = inf;
# ---------- end c_script_5 ----------

# ----
# Infill
number_slider_7 = Slider(12, range=0..100)
divide = DivideCurve(Curve=c_script_5.infWall, Count=number_slider_7, Kinks=False)  # -> Points, Tangents, Parameters
c_script_6 = CSharpScript(P=divide.Points)  # -> out, graft(ind); inputs P: tree
# ---------- c_script_6: C# ----------
    int len = P.BranchCount;
    List<int> index = new List<int>();
    for (int i = 0; i < len; i++)
    {
      index.Add(i % 2);
    }
    ind = index;
# ---------- end c_script_6 ----------
c_script_7 = CSharpScript(Border=divide.Points, y=c_script_6.ind)  # -> out, infPath; inputs Border: list of Point3d, y: Int32
# ---------- c_script_7: C# ----------
    int len = Border.Count;
    Print(y.ToString());
    List<Point3d> infillPath = new List<Point3d>();
    List<Point3d> shiftedBorder = new List<Point3d>();
    if (y == 1)
    {
      int len4 = len / 4;
      for (int i = len4+1; i < len; i++)
      {
        shiftedBorder.Add(Border[i]);
      }
      for (int i = 0; i <= len4; i++)
      {
        shiftedBorder.Add(Border[i]);
      }
      Border = shiftedBorder;
    }

    for (int i = 0; i < len / 2; i++)
    {
      infillPath.Add(Border[i]);
      infillPath.Add(Border[len - i - 1]);
    }
    if (len % 2 == 0)
    {
      infillPath.Add(Border[len / 2]);
    }
    infPath = infillPath;
# ---------- end c_script_7 ----------
pline = PolyLine(Vertices=c_script_7.infPath, Closed=False)

# ----
# Base wall
xy_3 = XYPlane(Origin=Point(0, 0, 0))
c_script_8 = CSharpScript(wall=c_script_5.baseWall, dist=number_slider_6, plane=xy_3)  # -> out, A; inputs wall: list of Curve, dist: Double, plane: Plane
# ---------- c_script_8: C# ----------
                            /*
      Compute base walls - create an offset to inside untill it's too small
    */
    List<Curve> inf = new List<Curve>();
    double prev_area = -1;
    for (int i = 0; i < wall.Count; i++)
    {
      double len = wall[i].GetLength();
      Curve tmp_offset = wall[i];
      inf.Add(tmp_offset);
      prev_area = -1;
      for (int j = 0; j < len / 2 ; j++)
      {
        Curve[] offset_crv = tmp_offset.Offset(plane, -dist * (j + 1), 0.01, CurveOffsetCornerStyle.None);
        if (offset_crv != null && Rhino.Geometry.AreaMassProperties.Compute(offset_crv[0]) != null && Rhino.Geometry.AreaMassProperties.Compute(offset_crv[0]).Area > 1)
        {
          if (prev_area == -1 || prev_area >= Rhino.Geometry.AreaMassProperties.Compute(offset_crv[0]).Area)
            inf.Add(offset_crv[0]);
          //else
          //inf.Add(offset_crv[0]);
          Print(i.ToString() + Rhino.Geometry.AreaMassProperties.Compute(offset_crv[0]).Area.ToString());
          prev_area = Rhino.Geometry.AreaMassProperties.Compute(offset_crv[0]).Area;
        }
        else
        {
          break;
        }
      }
    }

    A = inf;
# ---------- end c_script_8 ----------

# ----
# Merge:
# -texture
# -outer walls
# -infill
# -base
lng_2 = ListLength(List=c_script_2.A)
merge_2 = Merge(Data1=c_script_2.A, Data2=c_script_5.walls, Data3=pline, Data4=c_script_8.A)  # -> flatten(Result)
series = Series(Start=0, Step=1, Count=lng_2)
lng_3 = ListLength(List=series)
c_script_9 = CSharpScript(curves=merge_2, walls=lng_3)  # -> out, A; inputs curves: list of Curve, walls: Int32
# ---------- c_script_9: C# usings ----------
using System.Linq;
# ---------- c_script_9: C# ----------
    /*
      Compute in order of printing. Sort by z-axis parameter, then from outer to inner path (area)
    */
    List<Crv> all_crvs = new List<Crv>();
    for (int i = 0; i < curves.Count; i++)
    {
      Curve curr_curve = curves[i];
      Point3d pt = curr_curve.PointAtStart;
      Box b = new Box(Plane.WorldXY, curr_curve);
      double area = b.Area;
      int wall = 0;
      if (i <= walls)
      {
        wall = 1;
      }
      Crv curr_crv = new Crv(curr_curve, pt.Z, area, wall);
      all_crvs.Add(curr_crv);

    }
    List<Crv> outp = new List<Crv>();
    List<Curve> final = new List<Curve>();
    outp = all_crvs.OrderBy(x => x.Z_axis).ThenBy(x => -x.wall).ThenBy(x => -x.area).ToList();
    for (int i = 0; i < outp.Count; i++)
    {
      final.Add(outp[i].crv);
    }
    A = final;
# ---------- c_script_9: C# additional code ----------
  public class Crv
  {
    public Curve crv;
    public double Z_axis;
    public double area;
    public int wall;
    public Crv(Curve crv, double z_axis, double area, int wall)
    {
      this.crv = crv;
      this.Z_axis = z_axis;
      this.area = area;
      this.wall = wall;
    }
  }
# ---------- end c_script_9 ----------

# ----
# Generate g-code
dpath = DroidPaths(Polylines=c_script_9.A, SortZ=False, DroidVolume=dvolc.DroidVolume)
ppath = DroidPrintPaths(DroidPaths=dpath)
gcode = DroidGcodeCreator(DroidPaths=dpath, DroidParameters=dpmters, DroidHeader=start_code, Footer=end_code)  # -> flatten(Gcode), PrintInfo
saveg = DroidSaveGcode(Save=False, Gcode=gcode.Gcode)

filepicker = CreateFilePicker(ButtonLabelText="Browse...", DialogType=1, MustExist=True, Filter="All Files|*.*")
values_12 = ValueListener(Elements=filepicker, SomeProperty=True)  # -> Values, Indices
python = GhPythonScript(path=values_12.Values, file=gcode.Gcode)  # -> out, a
# ---------- python: Python ----------
__author__ = "zosia"
__version__ = "2023.02.08"

import rhinoscriptsyntax as rs

if (path[-6:] == ".gcode"):
    f = open(path, "w")
else:
     f = open(path+".gcode", "w");
f.write(file);
f.close()
# ---------- end python ----------

# ----
# "Printer settings" tab
number_slider_8 = Slider(21, range=0..100)
tb_4 = CreateTextBlock(Text="Save g-code file", TextSize=number_slider_8, Justification=1)
tb_5 = CreateTextBlock(Text="Adjust printer settings", TextSize=Slider(18, range=0..100), Justification=1)
merge_3 = Merge(
    Data1=flatten(tb_5),
    Data2=flatten(slider_4),
    Data3=flatten(slider_5),
    Data4=flatten(slider_7),
    Data5=flatten(slider_9),
    Data6=flatten(slider_6),
    Data7=flatten(slider_8),
    Data8=button,
    Data9=tb_4,
    Data10=filepicker)

# ----
# UI
adjustelem = AdjustElementAppearance(ElementsToAdjust=[tb, tb_2, tb_4, tb_3, tb_5], Foreground=colour)
merge_4 = Merge(
    Data1=flatten(tb),
    Data2=flatten(pickbtn),
    Data3=flatten(tb_2),
    Data4=flatten(slider),
    Data5=flatten(slider_3),
    Data6=flatten(slider_2),
    Data7=flatten(tb_4),
    Data8=flatten(filepicker),
    Data10=flatten(tb_3),
    Data11=flatten(shape))

# ----
# Generate UI
pan = Panel("Texture-Slicer")
pan_2 = Panel("""Texture
Printer settings""")
launchwin = LaunchWindow(
    Show=Toggle(True),
    Name=pan,
    Width=Slider(426, range=0..1000),
    Height=Slider(550, range=0..1000),
    ChildStatus=0,
    EnableHorizScroll=False)
accent_colors = ValueList({"Amber", "Blue", "Brown", "Cobalt", "Crimson", "Cyan", "Emerald", "Green", "Indigo", "Lime", "Magenta", "Mauve", "Olive", "Orange", "Pink", "Purple", "Red", "Sienna", "Steel", "Taupe", "Teal", "Violet", "Yellow"}, selected="Pink")
tabs = TabbedView(TabNames=pan_2, TabTextSize=Slider(16, range=0..100), Tab0=flatten(merge_4), Tab1=flatten(merge_3))
adjustelem_2 = AdjustElementAppearance(ElementsToAdjust=tabs, Foreground=colour, FontSize=colour)
addelems = AddElements(Window=launchwin, Elements=flatten(tabs), DoVLChecking=True)  # -> AddedElements, ElementNames
winprops = SetWindowProperties(Window=launchwin, AccentColor=accent_colors, ShowTitleBar=True, ScaleFactor=1)
